# Grasshopper definition recpa.gh (Grasshopper 1.0.7)

path = FilePath("C:\Users\81708\OneDrive\デスクトップ\rectangle\mian.py")
file = ReadFile(File=path, PerLineParse=False)
python = GhPythonScript(X=file)  # -> Out, A
panel = Panel(python.Out)
